# Grasshopper definition grasshopper_python.gh (Grasshopper 1.0.7)
# plug-ins: Anemone, Kangaroo2 Components, karambaGH

cabin_to_length_ratio = B(0.7)

# ---- group: Find Water Level
toggle = BooleanToggle(False)  # disabled
python = GhPythonScript(x=toggle)  # -> out, a; disabled
# ---------- python: Python ----------
__author__ = "alber"
__version__ = "2020.11.20"

import rhinoscriptsyntax as rs

coming = False

def main():
    coming = False
    if coming != x:
        a = True
        a = False
        coming = x

main()
# ---------- end python ----------
panel = Panel(python.a)  # disabled

# ----
timer = Timer(TimerInterval=500, Target=python_5)  # disabled
python_2 = GhPythonScript()  # -> out, parameters
# ---------- python_2: Python ----------
__author__ = "alber"
__version__ = "2020.12.15"

import rhinoscriptsyntax as rs
#parameters = [8, 23, 9, 13, 10, 30, 3]
parameters = [11.5,15,5.5,11.5,21.5,21.5,3]
parameters = [11.5,	25,	5.5,	11.5,	21.5,	21.5,	1.6667,]
# ---------- end python_2 ----------

toggle_2 = BooleanToggle(True)
python_3 = GhPythonScript(parameters=python_2.parameters)  # -> out, beam, LOA, reinforcements_x_count, reinforcements_y_count, reinforcements_width, reinforcements_height, speed; inputs parameters: list
# ---------- python_3: Python ----------
__author__ = "alber"
__version__ = "2020.12.03"

import rhinoscriptsyntax as rs

beam = float(parameters[0])
LOA = float(parameters[1])
reinforcements_x_count = float(parameters[2])
reinforcements_y_count = float(parameters[3])
reinforcements_width = float(parameters[4])
reinforcements_height = float(parameters[5])
speed = float(parameters[6])
# ---------- end python_3 ----------

python_4 = GhPythonScript(run=toggle_2)  # -> out, parameters, delayer_in; disabled
# ---------- python_4: Python ----------
__author__ = "alber"
__version__ = "2020.12.03"

import rhinoscriptsyntax as rs
from os import path
import time
import random

def is_not_equal(l1, l2):
    for i in range(len(l2)):
        if l1[i] != l2[i]:
            return True
    return False

print(random.random())
#parameters = [8, 23, 9, 13, 10, 30, 3]
filePath = r"C:\Users\alber\OneDrive - Imperial College London\UNIVERSITY\YEAR 3\Optimisation\PROJECT\simulation_output\grasshopper_input.csv"
delayer_in = False
# Only run if requested
if run == True:
#    Only run if the file exists
    if path.exists(filePath):
        with open(filePath) as csv_file:
#            Get the last line
            for new_par in csv_file:
                pass
        print(new_par)
        if is_not_equal(old_par, new_par):
            print("new found")
            parameters = new_par.split(",")
print("not found")
# ---------- end python_4 ----------
python_5 = GhPythonScript(run=toggle_2)  # -> out, parameters, delayer_in
# ---------- python_5: Python ----------
__author__ = "alber"
__version__ = "2020.12.03"

import rhinoscriptsyntax as rs
import os
import time

#parameters = [8, 23, 9, 13, 10, 30, 3]
filePath = r"C:\Users\alber\OneDrive - Imperial College London\UNIVERSITY\YEAR 3\Optimisation\PROJECT\simulation_output\grasshopper_input.csv"
delayer_in = False
# Only run if requested
if run == True:
#    Only run if the file exists
    if os.path.exists(filePath):
#       Read the file
        with open(filePath) as csv_file:
#            Get the last line
            for last_line in csv_file:
                pass
        print(last_line)
        parameters = last_line.split(",")
        os.remove(filePath)
# ---------- end python_5 ----------

reinforcements_x_count = Panel(python_3.reinforcements_x_count)
reinforcements_y_count = Panel(python_3.reinforcements_y_count)
reinforcements_width = Panel(python_3.reinforcements_width)
beam = Panel(python_3.beam)
loa = Panel(python_3.LOA)
reinforcements_height = Panel(python_3.reinforcements_height)
speed = Panel(python_3.speed)

# ---- group: Hull Geometry
ratio_of_nose_to_loa = Slider(0.2, range=0..1)
degrees_of_the_nose = Slider(54, range=20..150)
rad = Radians(Degrees=expr("90-x/2", degrees_of_the_nose))
tan = Tangent(Value=rad)
pt = ConstructPoint(XCoordinate=0, YCoordinate=0, ZCoordinate=0)
pt_2 = ConstructPoint(XCoordinate=0, YCoordinate=0, ZCoordinate=0)
Y = UnitY(Factor=1)
Z = UnitZ(Factor=Slider(1.3, range=1..2))
line = LineSDL(Start=pt_2, Direction=Y, Length=1)

# ----
beam_2 = Panel(beam)
loa_2 = Panel(loa)
beam_3 = Number(beam_2)
loa_3 = Number(loa_2)

passenger_weight = Panel("10")
loa_4 = Number(loa_3)
beam_4 = Number(beam_3)
multiplication = Multiplication(A=beam_4, B=loa_4, C=0.3)
addition = Addition(A=multiplication, B=passenger_weight)
total_weight_tons = Number(addition)
python_6 = GhPythonScript(req_V=total_weight_tons, LOA=loa_3, B=loa_3)  # -> out, D
# ---------- python_6: Python ----------
__author__ = "alber"
__version__ = "2020.12.10"

import rhinoscriptsyntax as rs
D = 1/(1-pow((req_V/(LOA*B/2)), 1/3))
# ---------- end python_6 ----------

draught = Number(python_6.D)

# ---- group: Find Water Level / Avg Weight from Vaporetto
loa_5 = Number(loa_3)  # disabled
beam_5 = Number(beam_3)  # disabled
multiplication_2 = Multiplication(A=beam_5, B=loa_5, C=0.3)  # disabled

# ---- group: FEA
reinforcements_x_count_2 = Panel(reinforcements_x_count)
reinforcements_height_2 = Panel(reinforcements_height)
reinforcements_y_count_2 = Panel(reinforcements_y_count)
reinforcements_width_2 = Panel(reinforcements_width)
addition_2 = Addition(A=reinforcements_y_count_2, B=1)

# ----
multiplication_3 = Multiplication(A=reinforcements_x_count_2, B=2)
addition_3 = Addition(A=multiplication_3, B=1)

# ---- group: FEA (continued)
subtraction = Subtraction(A=addition_3, B=1)

# ---- group: Hull Geometry (continued)
division = Division(A=beam_3, B=2)
multiplication_4 = Multiplication(A=loa_3, B=ratio_of_nose_to_loa)
multiplication_5 = Multiplication(
    A=draught,
    B=[Slider(0, range=0..1), Slider(0.4, range=0..1), Slider(0.3, range=0..1), Slider(0.26, range=0..1), Slider(0.22, range=0..1), Slider(0, range=0..1)])
multiplication_6 = Multiplication(
    A=draught,
    B=[Slider(0, range=0..1), Slider(0.4, range=0..1), Slider(0.61, range=0..1), Slider(0.61, range=0..1), Slider(0.38, range=0..1), Slider(0, range=0..1)])
multiplication_7 = Multiplication(
    A=division,
    B=[Slider(0, range=0..1), Slider(0.8, range=0..1), Slider(0.8, range=0..1), Slider(0.8, range=0..1), Slider(0.2, range=0..1), Slider(0, range=0..1)])
multiplication_8 = Multiplication(
    A=division,
    B=[Slider(0, range=0..1), Slider(0.8, range=0..1), Slider(0.8, range=0..1), Slider(0.7, range=0..1), Slider(0.1, range=0..1), Slider(0, range=0..1)])
multiplication_9 = Multiplication(
    A=loa_3,
    B=[Slider(0, range=0..1), Slider(0.01, range=0..1), Slider(0.6, range=0..1), Slider(0.7, range=0..1), Slider(1, range=0..1), Slider(1, range=0..1)])
multiplication_10 = Multiplication(
    A=loa_3,
    B=[Slider(0, range=0..1), Slider(0.01, range=0..1), Slider(0.6, range=0..1), Slider(0.7, range=0..1), Slider(1, range=0..1), Slider(1, range=0..1)])
multiplication_11 = Multiplication(
    A=loa_3,
    B=[Slider(0, range=0..1), Slider(0.01, range=0..1), Slider(0.4, range=0..1), Slider(0.8, range=0..1), Slider(1, range=0..1), Slider(1, range=0..1)])
multiplication_12 = Multiplication(
    A=draught,
    B=[Slider(0, range=0..1), Slider(0.4, range=0..1), Slider(1, range=0..1), Slider(1, range=0..1), Slider(0.6, range=0..1), Slider(0, range=0..1)])
pt_3 = ConstructPoint(XCoordinate=multiplication_7, YCoordinate=multiplication_9, ZCoordinate=expr("-x", multiplication_5))
pt_4 = ConstructPoint(XCoordinate=multiplication_8, YCoordinate=multiplication_10, ZCoordinate=expr("-x", multiplication_6))
pt_5 = ConstructPoint(XCoordinate=0, YCoordinate=multiplication_11, ZCoordinate=expr("-x", multiplication_12))
division_2 = Division(A=multiplication_4, B=tan)
subtraction_2 = Subtraction(A=loa_3, B=multiplication_4)
subtraction_3 = Subtraction(A=division, B=division_2)
pline = PolyLine(Vertices=flatten(pt_5), Closed=False)
item = ListItem(List=pt_4, Index=1, Wrap=True)
item_2 = ListItem(List=pt_3, Index=1, Wrap=True)
pline_2 = PolyLine(Vertices=flatten(pt_3), Closed=False)
pline_3 = PolyLine(Vertices=flatten(pt_4), Closed=False)
item_3 = ListItem(List=pt_5, Index=1, Wrap=True)
pt_6 = ConstructPoint(XCoordinate=division, YCoordinate=0, ZCoordinate=0)
pt_7 = ConstructPoint(XCoordinate=division, YCoordinate=subtraction_2, ZCoordinate=0)
pt_8 = ConstructPoint(XCoordinate=subtraction_3, YCoordinate=loa_3, ZCoordinate=0)
pt_9 = ConstructPoint(XCoordinate=0, YCoordinate=loa_3, ZCoordinate=0)
pt_10 = Point(flatten([pt, pt_6, pt_7, pt_8, pt_9]))
item_4 = ListItem(List=pt_10, Index=0, Wrap=True)  # -> flatten(Item)
pline_4 = PolyLine(Vertices=flatten(pt_10), Closed=False)
item_5 = ListItem(List=pt_10, Index=1, Wrap=True)  # -> flatten(Item)
pline_5 = PolyLine(Vertices=pt_10, Closed=False)
fillet = Fillet(Curve=pline_5, Radius=Slider(10, range=0..10))
crv_cp = CurveClosestPoint(Point=pt_10, Curve=fillet)  # -> Point, Parameter, Distance
pline_6 = PolyLine(Vertices=flatten([item_5, item_2, item, item_3]), Closed=False)
extr = Extrude(Base=fillet, Direction=Z)
rotax = RotateAxis(Geometry=pline, Angle=expr("-x", Slider(0.09, range=0..0.5)), Axis=line)  # -> Geometry, Transform
merge = Merge(Data1=pline_4, Data2=pline_2, Data3=pline_3, Data4=rotax.Geometry, Data5=pline)
curvepoint = PointOnCurve(merge, parameter=0.765)
curvepoint_2 = PointOnCurve(merge, parameter=0.765)
curvepoint_3 = PointOnCurve(merge, parameter=0.236)
curvepoint_4 = PointOnCurve(merge, parameter=0.557)
pline_7 = PolyLine(Vertices=curvepoint_4, Closed=False)
pline_8 = PolyLine(Vertices=curvepoint, Closed=False)
pline_9 = PolyLine(Vertices=curvepoint_3, Closed=False)
pline_10 = PolyLine(Vertices=curvepoint_2, Closed=False)
merge_2 = Merge(Data1=pline_6, Data2=pline_9, Data3=pline_7, Data4=pline_10)
merge_3 = Merge(Data1=pline_4, Data2=pline_2, Data4=rotax.Geometry)
mirror = Mirror(Geometry=merge_3, Plane=PlaneYZ(0, 0, 0))  # -> reverse(Geometry), Transform
mirror_2 = Mirror(Geometry=merge_2, Plane=PlaneYZ(0, 0, 0))  # -> Geometry, Transform
join = JoinCurves(Curves=[mirror_2.Geometry, merge_2], Preserve=False)
merge_4 = Merge(Data1=merge_3, Data2=mirror.Geometry)
fillet_2 = Fillet(Curve=join, Radius=Slider(10, range=0..10))
fillet_3 = Fillet(Curve=merge_4, Radius=Slider(10, range=0..10))
netsurf = NetworkSurface(CurvesU=fillet_3, CurvesV=fillet_2, Continuity=Slider(2, range=0..4))

# ---- group: Hull Geometry / Box
cabin_height = Slider(3, range=2..4)
multiplication_13 = Multiplication(A=loa_3, B=cabin_to_length_ratio)
pt_11 = ConstructPoint(XCoordinate=expr("-x", 0), YCoordinate=multiplication_13, ZCoordinate=cabin_height)
box = Box2Pt(PointA=pt_6, PointB=pt_11, Plane=PlaneXY(0, 0, 0))

# ---- group: Hull Geometry / Simplified Structure
cull_i = CullIndex(List=merge_4, Indices=[Slider(4, range=0..5), Slider(1, range=0..1)], Wrap=True)
cull_i_2 = CullIndex(List=join, Indices=[Slider(0, range=0..100), Slider(2, range=0..4)], Wrap=True)
netsurf_2 = NetworkSurface(CurvesU=cull_i, CurvesV=cull_i_2, Continuity=Slider(0, range=0..4))
geo = Geometry(netsurf_2)

# ---- group: Hull Geometry (continued)
geo_2 = Geometry(flatten([extr, box]))
mirror_3 = Mirror(Geometry=geo_2, Plane=PlaneYZ(0, 0, 0))  # -> Geometry, Transform
merge_5 = Merge(Data1=mirror_3.Geometry, Data2=geo_2)  # -> flatten(Result)

# ----
water_level = Panel("1")
pl_offset = PlaneOffset(BasePlane=PlaneXY(0, 0, 0), Offset=expr("-x", water_level))
geo_3 = Geometry(geo)
sec = BrepPlane(Brep=geo_3, Plane=pl_offset)  # -> Curves, Points
patch = Patch(Curves=sec.Curves, Spans=20, Flexibility=1, Trim=invert(True))
split = SplitBrep(Brep=geo_3, Cutter=patch)
split_2 = SplitBrep(Brep=patch, Cutter=geo_3)
item_6 = ListItem(List=flatten(split_2), Index=Slider(1, range=0..10), Wrap=True)
item_7 = ListItem(List=flatten(split), Index=Slider(1, range=0..10), Wrap=True)
join_2 = BrepJoin(Breps=flatten([item_6, item_7]))  # -> Breps, Closed
volume = Volume(Geometry=join_2.Breps)  # -> Volume, Centroid

multiplication_14 = Multiplication(A=beam_3, B=multiplication_13)
geo_4 = Geometry(geo)  # disabled

# ---- group: FEA
panel_2 = Panel("""True
False""")
v_count = Number(subtraction)
integer_division = IntegerDivision(A=v_count, B=2)
number_slider = Slider(-1, range=-2..0)
number_slider_2 = Slider(1, range=0..1)
number_slider_3 = Slider(0, range=-2..0)
vec = VectorXYZ(XComponent=1, YComponent=0, ZComponent=1)  # -> Vector, Length
vec_2 = VectorXYZ(XComponent=-1, YComponent=0, ZComponent=1)  # -> Vector, Length
dom = ConstructDomain(DomainStart=1, DomainEnd=expr("x-1", integer_division))
dom_2 = ConstructDomain(DomainStart=expr("x+1", integer_division), DomainEnd=expr("x-1", v_count))
unit = UnitVector(Vector=vec_2.Vector)
unit_2 = UnitVector(Vector=vec.Vector)
cross_section = CrossSectionKaramba3D(
    FamilyNameOfCrossSection="DefaultCroSec",
    ElementIdentifier="Ribs",
    Material=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,
    Height_cm=reinforcements_height_2,
    UpperFlangeWidth_cm=reinforcements_width_2,
    LowerFlangeWidth_cm=reinforcements_width_2,
    mode="Trapezoid")
matselect = MaterialSelectionKaramba3D(ElementIdentifier="Ribs", menu=[dropdown(1), dropdown(71)])
material = MaterialKaramba3D(flatten(matselect))
crosec = CrossSectionKaramba3D(flatten(cross_section))

# ---- group: FEA / Force Per Node
multiplication_15 = Multiplication(A=addition_2, B=subtraction)
panel_3 = Panel("10000")
draught_2 = Number(draught)
multiplication_16 = Multiplication(A=panel_3, B=draught_2)

# ----
geo_5 = Geometry(item_7)
geo_6 = Geometry(join_2.Breps)
geo_7 = Geometry(geo)
edges = BrepEdges(Brep=geo_6)  # -> Naked, Interior, NonManifold
yz = YZPlane(Origin=Point(0, 0, 0))
pcx = CurvePlane(Curve=edges.Interior, Plane=yz)  # -> flatten(Points), ParamsC, ParamsP
xz = XZPlane(Origin=Point(0, 0, 0))
loa_6 = Number(loa_3)
pl_offset_2 = PlaneOffset(BasePlane=xz, Offset=expr("-x/2", loa_6))
pcx_2 = CurvePlane(Curve=edges.Interior, Plane=pl_offset_2)  # -> flatten(Points), ParamsC, ParamsP
ln = Line(StartPoint=reverse(pcx_2.Points), EndPoint=pcx_2.Points)
ln_2 = Line(StartPoint=reverse(pcx.Points), EndPoint=pcx.Points)
item_8 = ListItem(List=ln, Index=0, Wrap=True)
item_9 = ListItem(List=ln_2, Index=0, Wrap=True)
sec_2 = BrepPlane(Brep=geo_6, Plane=pl_offset_2)  # -> Curves, Points
pcx_3 = CurvePlane(Curve=sec_2.Curves, Plane=yz)  # -> flatten(Points), ParamsC, ParamsP
ln_3 = Line(StartPoint=reverse(pcx_3.Points), EndPoint=pcx_3.Points)
item_10 = ListItem(List=ln_3, Index=0, Wrap=True)
len = Length(Curve=item_10)
len_2 = Length(Curve=item_8)
len_3 = Length(Curve=item_9)
join_3 = JoinCurves(Curves=flatten(sec_2.Curves), Preserve=False)
b_molded_beam = Number(len_2)
t_molded_mean_draught = Number(len)
lwl_length_in_waterline = Number(len_3)
area = Area(Geometry=join_3)  # -> Area, Centroid
Y_2 = UnitY(Factor=len_3)
speed_2 = Panel(speed)
v_s = Number(speed_2)
water_kin_vis_at_7deg = Panel("0.0000010533")
kin_vis = Number(water_kin_vis_at_7deg)
reynolds_py = GhPythonScript(v_s=v_s, LWL=lwl_length_in_waterline, kinematic_viscosity=kin_vis)  # -> out, Re
# ---------- reynolds_py: Python ----------
__author__ = "alber"
__version__ = "2020.12.02"

import rhinoscriptsyntax as rs

Re = v_s*LWL/float(kinematic_viscosity)
# ---------- end reynolds_py ----------
froude_py = GhPythonScript(v_s=v_s, LWL=lwl_length_in_waterline)  # -> out, Fr
# ---------- froude_py: Python ----------
__author__ = "alber"
__version__ = "2020.12.02"

import rhinoscriptsyntax as rs
from math import sqrt
Fr = v_s/(sqrt(9.81*LWL))
# ---------- end froude_py ----------
c_f_py = GhPythonScript(Re=reynolds_py.Re)  # -> out, C_f
# ---------- c_f_py: Python ----------
__author__ = "alber"
__version__ = "2020.12.02"

import rhinoscriptsyntax as rs
from math import log
"""from eq 2.18"""
C_f = 0.075/(log(Re, 10)-2)**2
# ---------- end c_f_py ----------
area_2 = Area(Geometry=geo_5)  # -> Area, Centroid
division_3 = Division(A=degrees_of_the_nose, B=2)
r_f_py = GhPythonScript(v_s=v_s, wetted_surface=area_2.Area, C_f=c_f_py.C_f)  # -> out, R_F
# ---------- r_f_py: Python ----------
__author__ = "alber"
__version__ = "2020.12.02"

import rhinoscriptsyntax as rs

R_F = 0.5*1000*v_s*v_s*wetted_surface*C_f
# ---------- end r_f_py ----------

# ---- group: Emersed Frontal Area
sec_3 = BrepPlane(Brep=geo_7, Plane=pl_offset_2)  # -> Curves, Points
xz_2 = XZPlane(Origin=Point(0, 0, 0))
geo_8 = Geometry(merge_5)
end = EndPoints(Curve=sec_3.Curves)  # -> Start, End
project = Project(Geometry=geo_8, Plane=xz_2)  # -> Geometry, Transform
ln_4 = Line(StartPoint=end.Start, EndPoint=end.End)
join_4 = JoinCurves(Curves=flatten([sec_3.Curves, ln_4]), Preserve=False)
area_3 = Area(Geometry=project.Geometry)  # -> Area, Centroid
area_4 = Area(Geometry=join_4)  # -> Area, Centroid
ma = MassAddition(Input=area_3.Area)  # -> Result, PartialResults
addition_4 = Addition(A=ma.Result, B=area_4.Area)
subtraction_4 = Subtraction(A=addition_4, B=area.Area)

# ---- group: C_M (Midship Section Coefficient)
join_5 = JoinCurves(Curves=edges.Interior, Preserve=False)
multiplication_17 = Multiplication(A=lwl_length_in_waterline, B=b_molded_beam)
area_5 = Area(Geometry=join_5)  # -> Area, Centroid
division_4 = Division(A=area_5.Area, B=multiplication_17)
c_m_midship_section_coefficient = Number(division_4)

# ----
volume_2 = Volume(Geometry=geo_6)  # -> Volume, Centroid
v_volumetric_displacement_molded = Number(volume_2.Volume)

# ---- group: Prismatic Coefficient
multiplication_18 = Multiplication(A=area.Area, B=len_3)
division_5 = Division(A=v_volumetric_displacement_molded, B=multiplication_18)
c_p_prismatic_coefficient_lwl = Number(division_5)

# ----
pdecon = Deconstruct(Point=volume_2.Centroid)  # -> XComponent, YComponent, ZComponent
l_cb = GhPythonScript(center_of_buoyancy=pdecon.YComponent, LWL=lwl_length_in_waterline)  # -> out, l_CB
# ---------- l_cb: Python ----------
__author__ = "alber"
__version__ = "2020.12.03"

import rhinoscriptsyntax as rs
l_CB = (center_of_buoyancy - LWL/2) / LWL * 100
# ---------- end l_cb ----------
r_w_wave_resistance = GhPythonScript(
    Fr=froude_py.Fr,
    C_P=c_p_prismatic_coefficient_lwl,
    i_E=division_3,
    B=b_molded_beam,
    T=t_molded_mean_draught,
    C_M=c_m_midship_section_coefficient,
    LWL=lwl_length_in_waterline,
    V=v_volumetric_displacement_molded)  # -> out, R_W
# ---------- r_w_wave_resistance: Python ----------
__author__ = "alber"
__version__ = "2020.12.02"

import rhinoscriptsyntax as rs
from math import exp, sqrt, cos
""" from eq 5.20 """
A_BT = 0
A_T = 0
T_F = 0
h_B = 0
c_7 = B/LWL
c_1 = 2223105*pow(c_7, 3.78613) * (T/B) * pow((90 - i_E), -1.37565)
#c_3 = 0.56*pow(A_BT, 1.5) / (B*T*(0.31*sqrt(A_BT) + T_F - h_B))
#c_3 = 0
#c2 = exp(-1.89 * sqrt(c_3))
c_2 = 0
c_5 = 1-0.8*A_T/(B*T*C_M)
p = 1000
g = 9.81
c_16 = 8.07981*C_P - 13.8673*pow(C_P, 2) + 6.984388*pow(C_P, 3)
m1 = 0.0140407*LWL/T - 1.75254*pow(V, 1/3)/LWL - 4.79323*B/LWL - c_16

d = -0.9
c_15 = -1.69385

m4 = 0.4*c_15*exp(-0.034*pow(Fr, -3.29))
lambda_ = 1.446*C_P - 0.03*LWL/B
R_W = c_1 * c_2 * c_5 * p * g * V * exp(m1 * pow(Fr, d) + m4 * cos(lambda_ * pow(Fr, -2)))
# ---------- end r_w_wave_resistance ----------
air_resistance = GhPythonScript(v_S=v_s, A_V=subtraction_4)  # -> out, R_AA
# ---------- air_resistance: Python ----------
__author__ = "alber"
__version__ = "2020.12.02"

import rhinoscriptsyntax as rs
p_A = 1.225 #air density
C_DA = 0.8 #air drag coeff.

R_AA = 0.5 * p_A * v_S**2 * C_DA * A_V
# ---------- end air_resistance ----------
ghpython_script = GhPythonScript(
    B=b_molded_beam,
    LWL=lwl_length_in_waterline,
    T=t_molded_mean_draught,
    l_CB=l_cb.l_CB,
    V=v_volumetric_displacement_molded,
    C_P=c_p_prismatic_coefficient_lwl)  # -> out, k
# ---------- ghpython_script: Python ----------
__author__ = "alber"
__version__ = "2020.12.03"

import rhinoscriptsyntax as rs

L_R = LWL * (1-C_P + 0.06*C_P*l_CB) / (4*C_P - 1)
c_14 = 1

k = -0.07+ 0.487118 * c_14 * (pow(B/LWL, 1.06806) * pow(T/LWL, -0.46106) * pow(LWL/L_R, 0.121563) * pow(LWL/V, 0.36486) * pow(1-C_P, -0.604247))
# ---------- end ghpython_script ----------
total_resistance = GhPythonScript(k=ghpython_script.k, R_F=r_f_py.R_F, R_W=r_w_wave_resistance.R_W, R_AA=air_resistance.R_AA)  # -> out, R_T
# ---------- total_resistance: Python ----------
__author__ = "alber"
__version__ = "2020.12.03"

import rhinoscriptsyntax as rs
R_T = (1+k) * R_F + R_W + R_AA
# ---------- end total_resistance ----------

# ---- group: Costs / Petrol Cost / Power
speed_3 = Panel(speed)
friction_force = Number(total_resistance.R_T)
multiplication_19 = Multiplication(A=friction_force, B=speed_3)

# ---- group: Costs / Petrol Cost
petrol_per_kwh = Panel("0.2")
price_of_petrol = Panel("1.84705882")
multiplication_20 = Multiplication(A=multiplication_19, B=petrol_per_kwh)
multiplication_21 = Multiplication(A=multiplication_20, B=price_of_petrol)
ferry_life_expectancy = Panel("8000")
petrol_cost_per_hour = Panel(multiplication_21)
multiplication_22 = Multiplication(A=petrol_cost_per_hour, B=ferry_life_expectancy)

# ---- group: FEA (continued)
geo_9 = Geometry(geo_7)
divide = DivideDomain²(Domain=geo_9, UCount=addition_2, VCount=subtraction)
subsrf = Isotrim(Surface=geo_9, Domain=divide)
join_6 = BrepJoin(Breps=subsrf)  # -> Breps, Closed
cull = CullPattern(List=subsrf, CullPattern=invert(panel_2))
cull_2 = CullPattern(List=subsrf, CullPattern=panel_2)
edges_2 = BrepEdges(Brep=join_6.Breps)  # -> Naked, Interior, NonManifold
debrep = DeconstructBrep(Brep=cull_2)  # -> Faces, Edges, simplify(Vertices)
debrep_2 = DeconstructBrep(Brep=cull)  # -> Faces, Edges, simplify(Vertices)
reb = RebuildCurve(Curve=flatten(edges_2.Naked), Degree=Slider(1, range=0..1), Count=Slider(2, range=0..10), Tangents=False)
item_11 = ListItem(List=debrep_2.Vertices, Index=0, Wrap=True)  # -> Item, Item1, Item2, Item3
item_12 = ListItem(List=debrep.Vertices, Index=0, Wrap=True)  # -> Item, Item1, Item2, Item3
ln_5 = Line(StartPoint=item_11.Item, EndPoint=item_11.Item1)
ln_6 = Line(StartPoint=item_12.Item, EndPoint=item_12.Item1)
ln_7 = Line(StartPoint=item_12.Item, EndPoint=item_12.Item3)
ln_8 = Line(StartPoint=item_11.Item, EndPoint=item_11.Item3)
join_7 = JoinCurves(Curves=flatten([ln_7, ln_8]), Preserve=False)
explode = Explode(Curve=edges_2.Naked, Recursive=True)  # -> simplify(Segments), simplify(Vertices)
explode_2 = Explode(Curve=join_7, Recursive=True)  # -> simplify(Segments), simplify(Vertices)
duppt = RemoveDuplicatePts(Points=explode.Vertices, Tolerance=0.01)
cull_3 = CullPattern(List=flatten(duppt), CullPattern=[True, False])
subset = SubList(List=explode_2.Vertices, Domain=dom, Wrap=True)  # -> List, Index
subset_2 = SubList(List=explode_2.Vertices, Domain=dom_2, Wrap=True)  # -> List, Index
item_13 = ListItem(List=explode_2.Vertices, Index=integer_division, Wrap=True)
item_14 = ListItem(List=flatten(cull_3), Index=number_slider_3, Wrap=True)
cull_i_3 = CullIndex(List=flatten(cull_3), Indices=[number_slider_3, number_slider], Wrap=True)
item_15 = ListItem(List=flatten(cull_3), Index=number_slider, Wrap=True)
supp = SupportKaramba3D(PosInd=item_14, menu=[buttons(on, on, on, on, on, on)])
supp_2 = SupportKaramba3D(PosInd=item_15, menu=[buttons(on, off, on, on, on, on)])
supp_3 = SupportKaramba3D(PosInd=cull_i_3, menu=[buttons(on, off, off, off, off, off)])
support = SupportKaramba3D(flatten([supp, supp_2, supp_3]))

# ---- group: FEA / Force Per Node (continued)
area_6 = Area(Geometry=geo_9)  # -> Area, Centroid
division_6 = Division(A=area_6.Area, B=multiplication_15)
multiplication_23 = Multiplication(A=division_6, B=multiplication_16)
division_7 = Division(A=multiplication_23, B=1000)
division_8 = Division(A=division_7, B=4)

# ----
geo_10 = Geometry(item_11.Item3)
ln_9 = Line(StartPoint=item_12.Item2, EndPoint=item_12.Item3)
ln_10 = Line(StartPoint=item_11.Item2, EndPoint=item_11.Item3)

# ---- group: FEA (continued)
join_8 = JoinCurves(Curves=flatten([ln_6, ln_5, ln_9, ln_10]), Preserve=False)
explode_3 = Explode(Curve=join_8, Recursive=True)  # -> simplify(Segments), simplify(Vertices)
linetobeam = LineToBeamKaramba3D(
    Line=flatten([explode_2.Segments, explode_3.Segments, explode.Segments]),
    Identifier="Ribs",
    New=True,
    Remove=True,
    LimitDistance_m=0.005,
    Bending=Toggle(True))  # -> Element, Points, Info
force_per_node = Number(division_8)
multiplication_24 = Multiplication(A=unit_2, B=force_per_node)
multiplication_25 = Multiplication(A=unit, B=force_per_node)
Z_2 = UnitZ(Factor=force_per_node)
loads = LoadsKaramba3D(ForceVector=multiplication_25, Local=False, PosInd=subset.List, LCase=0, mode="Point")
loads_2 = LoadsKaramba3D(ForceVector=Z_2, Local=False, PosInd=item_13, LCase=0, mode="Point")
loads_3 = LoadsKaramba3D(ForceVector=multiplication_24, Local=False, PosInd=subset_2.List, LCase=0, mode="Point")
element = ElementKaramba3D(flatten(linetobeam.Element))
load = LoadKaramba3D(flatten([loads, loads_3, loads_2]))
assemble = AssembleModelKaramba3D(Elem=element, Support=support, Load=load, CrossSection=crosec, Material=material, LimitDistance_m=0.005)  # -> Model, Info, Mass_kg, CenterOfGravity
analyzethii = AnalyzeThIIKaramba3D(Model=assemble.Model, LoadCase=-1, RTolerance=1e-07, MaxIterations=50, NoTensionalNII=False)  # -> CalculatedModel, MaximumDisplacement_cm, ResultingForceOfGravity_kN, ElasticEnergy_kNm
beamview = BeamViewKaramba3D(Model=analyzethii.CalculatedModel)  # -> Model, MeshesOfRenderedBeams, DeformedBeamAxes, LegendColors, LegendTags
bmodes = BucklingModesKaramba3D(Model=analyzethii.CalculatedModel, FromIndex=1, NumberOfModes=1, MaximumNumberOfIterations=300, Epsilon=1e-07)  # -> ModelWithBucklingModesAsLoadCaseResults, BucklingLoadFactors

# ----
beamview_2 = BeamViewKaramba3D(Model=assemble.Model)  # -> Model, MeshesOfRenderedBeams, DeformedBeamAxes, LegendColors, LegendTags
demesh = DeconstructMesh(Mesh=beamview.MeshesOfRenderedBeams)  # -> Vertices, Faces, Colours, Normals
demesh_2 = DeconstructMesh(Mesh=beamview_2.MeshesOfRenderedBeams)  # -> Vertices, Faces, Colours, Normals
subtraction_5 = Subtraction(A=demesh.Vertices, B=demesh_2.Vertices)
vlen = VectorLength(Vector=flatten(subtraction_5))
sort = SortList(Keys=vlen)  # -> Keys, ValuesA
item_16 = ListItem(List=sort.Keys, Index=-1, Wrap=True)

# ---- group: FEA
max_displacement = Panel(item_16)
buckling_load_factor = Panel(bmodes.BucklingLoadFactors)
mass = Panel(assemble.Mass_kg)

# ---- group: Costs / Material Cost
material_weight = Number(mass)
material_cost_kg = Panel("4")
material_weight_2 = Panel(material_weight)
multiplication_26 = Multiplication(A=material_weight_2, B=material_cost_kg)
material_cost = Panel(multiplication_26)

# ---- group: Costs
addition_5 = Addition(A=multiplication_22, B=material_cost)
total_lifetime_cost = Panel(addition_5)

# ----
division_9 = Division(A=total_lifetime_cost, B=1000)

merge_6 = Merge(
    Data1=flatten(division_9),
    Data2=flatten(buckling_load_factor),
    Data3=flatten(max_displacement),
    Data4=flatten(multiplication_14))  # -> flatten(Result)
python_7 = GhPythonScript(outputParameters=merge_6)  # -> out, out_par; inputs outputParameters: list
# ---------- python_7: Python ----------
__author__ = "alber"
__version__ = "2020.12.04"

import rhinoscriptsyntax as rs


filePath = r"C:\Users\alber\OneDrive - Imperial College London\UNIVERSITY\YEAR 3\Optimisation\PROJECT\simulation_output\grasshopper_output.csv"
def is_valid_list(list):
    for element in list:
        if not (isinstance(element, float) or isinstance(element, str) or isinstance(element, int)):
            print("Not a valid list")
            return False
    print("Valid list")
    return True

#if delayer_out:
if outputParameters:
    print(outputParameters)
    if is_valid_list(outputParameters):
    #    create the file to write
        file = open(filePath, 'w')
    
    #    write the numbers
        for i in range(len(outputParameters)):
#            print(outputParameters[i])
            if i != len(outputParameters)-1:
                file.write(str(outputParameters[i]) + ', ')
            else:
                file.write(str(outputParameters[i]))
        
    #    close the file
        file.close()
# ---------- end python_7 ----------

panel_4 = Panel(merge_6)
panel_5 = Panel(python_7.out)

# ---- group: Find Water Level
i_0_volume = Slider(0, range=0..100)  # disabled
number_slider_4 = Slider(24, range=0..50)  # disabled
number_slider_5 = Slider(100000, range=0..1000000)  # disabled
toggle_3 = BooleanToggle(True)  # disabled
num = Number(draught)  # disabled
loop_start = LoopStart(N=number_slider_4, T=python.a, D0=number_slider_5, D1=i_0_volume, D2=num)  # -> port, Counter, Data, Data_2, Data_3; disabled
panel_6 = Panel(loop_start.Counter)  # disabled
number_slider_6 = Slider(50000, range=10000..1000000)  # disabled
subtraction_6 = Subtraction(A=loop_start.Data, B=loop_start.Data_2)  # disabled

water_level_2 = Number(loop_start.Data_3)  # disabled
geo_11 = Geometry(netsurf_2)  # disabled
pl_offset_3 = PlaneOffset(BasePlane=PlaneXY(0, 0, 0), Offset=expr("-x", water_level_2))  # disabled
sec_4 = BrepPlane(Brep=geo_11, Plane=pl_offset_3)  # -> Curves, Points; disabled
patch_2 = Patch(Curves=sec_4.Curves, Spans=20, Flexibility=1, Trim=invert(True))  # disabled
split_3 = SplitBrep(Brep=geo_11, Cutter=patch_2)  # disabled
split_4 = SplitBrep(Brep=patch_2, Cutter=geo_11)  # disabled
number_slider_7 = Slider(1, range=0..10)  # disabled
number_slider_8 = Slider(1, range=0..10)  # disabled
item_17 = ListItem(List=flatten(split_4), Index=number_slider_8, Wrap=True)  # disabled
item_18 = ListItem(List=flatten(split_3), Index=number_slider_7, Wrap=True)  # disabled
join_9 = BrepJoin(Breps=flatten([item_17, item_18]))  # -> Breps, Closed; disabled
volume_3 = Volume(Geometry=join_9.Breps)  # -> Volume, Centroid; disabled

geo_12 = Geometry(geo)  # disabled
number_slider_9 = Slider(1, range=0..10)  # disabled
number_slider_10 = Slider(1, range=0..10)  # disabled

number_slider_11 = Slider(10, range=0..10)  # disabled
number_slider_12 = Slider(20, range=0..50)  # disabled
geo_13 = Geometry(geo)  # disabled
number_slider_13 = Slider(1000, range=0..1000)  # disabled
python_8 = GhPythonScript(x=geo_13)  # -> out, a; disabled
# ---------- python_8: Python ----------
__author__ = "alber"
__version__ = "2020.11.29"

import rhinoscriptsyntax as rs

old = x
a = False
print(x)
if old != x:
    a = True
    old = x
else:
    a = False
# ---------- end python_8 ----------
water_level_3 = Panel("1")  # disabled

pl_offset_4 = PlaneOffset(BasePlane=PlaneXY(0, 0, 0), Offset=expr("-x", water_level_3))  # disabled
sec_5 = BrepPlane(Brep=geo_12, Plane=pl_offset_4)  # -> Curves, Points; disabled
patch_3 = Patch(Curves=sec_5.Curves, Spans=20, Flexibility=1, Trim=invert(True))  # disabled
split_5 = SplitBrep(Brep=geo_12, Cutter=patch_3)  # disabled
split_6 = SplitBrep(Brep=patch_3, Cutter=geo_12)  # disabled
item_19 = ListItem(List=flatten(split_6), Index=number_slider_9, Wrap=True)  # disabled
item_20 = ListItem(List=flatten(split_5), Index=number_slider_10, Wrap=True)  # disabled
join_10 = BrepJoin(Breps=flatten([item_19, item_20]))  # -> Breps, Closed; disabled
volume_4 = Volume(Geometry=join_10.Breps)  # -> Volume, Centroid; disabled

number_slider_14 = Slider(50, range=0..50)  # disabled
passenger_weight_2 = Panel("10")  # disabled
toggle_4 = BooleanToggle(True)  # disabled
panel_7 = Panel("1")  # disabled
addition_6 = Addition(A=multiplication_2, B=passenger_weight_2)  # disabled
number_slider_15 = Slider(1000, range=0..1000000)  # disabled
total_weight_tons_2 = Number(addition_6)  # disabled
loop_start_2 = LoopStart(
    N=number_slider_14,
    T=toggle_4,
    Weight_target_Volume=total_weight_tons_2,
    Initial_Guess=volume_4.Volume,
    Scaling_Factor=panel_7)  # -> port, Counter, Data, Data_2, Data_3; disabled
subtraction_7 = Subtraction(A=loop_start_2.Data, B=loop_start_2.Data_2)  # disabled
toggle_5 = BooleanToggle(False)  # disabled
python_9 = GhPythonScript(Target_Volume=total_weight_tons_2, Current_Volume=loop_start_2.Data_2)  # -> out, end; disabled
# ---------- python_9: Python ----------
__author__ = "alber"
__version__ = "2020.11.29"

import rhinoscriptsyntax as rs
end = False
relative_error = (abs((Target_Volume-Current_Volume))) / (Target_Volume)
if(relative_error <= 0.05):
    end = True
else:
    end = False
# ---------- end python_9 ----------
or = GateOr(A=toggle_5, B=python_9.end)  # disabled
scale_nu = ScaleNU(Geometry=geo_4, Plane=PlaneXY(0, 0, 0), ScaleX=1, ScaleY=1, ScaleZ=loop_start_2.Data_3)  # -> Geometry, Transform; disabled

pl_offset_5 = PlaneOffset(BasePlane=PlaneXY(0, 0, 0), Offset=expr("-x", water_level_3))  # disabled
geo_14 = Geometry(scale_nu.Geometry)  # disabled
sec_6 = BrepPlane(Brep=geo_14, Plane=pl_offset_5)  # -> Curves, Points; disabled
patch_4 = Patch(Curves=sec_6.Curves, Spans=20, Flexibility=1, Trim=invert(True))  # disabled
split_7 = SplitBrep(Brep=geo_14, Cutter=patch_4)  # disabled
split_8 = SplitBrep(Brep=patch_4, Cutter=geo_14)  # disabled
number_slider_16 = Slider(1, range=0..10)  # disabled
number_slider_17 = Slider(1, range=0..10)  # disabled
item_21 = ListItem(List=flatten(split_8), Index=number_slider_17, Wrap=True)  # disabled
item_22 = ListItem(List=flatten(split_7), Index=number_slider_16, Wrap=True)  # disabled
join_11 = BrepJoin(Breps=flatten([item_21, item_22]))  # -> Breps, Closed; disabled
volume_5 = Volume(Geometry=join_11.Breps)  # -> Volume, Centroid; disabled

subtraction_8 = Subtraction(A=total_weight_tons_2, B=volume_4.Volume)  # disabled
multiplication_27 = Multiplication(A=subtraction_8, B=number_slider_12)  # disabled
abs = Absolute(Value=multiplication_27)  # disabled
python_10 = GhPythonScript(ended=python_9.end, immersed_volume_in=join_11.Breps, wetted_surface_in=item_22, scaled_hull_in=scale_nu.Geometry)  # -> out, immersed_volume_out, wetted_surface_out, scaled_hull_out; disabled
# ---------- python_10: Python ----------
__author__ = "alber"
__version__ = "2020.11.29"

import rhinoscriptsyntax as rs

immmersed_volume_out = float("NaN")
scaled_hull_out = float("NaN")
wetted_surface_out = float("NaN")


if (ended):
    print("Finished")
    immersed_volume_out = immersed_volume_in
    scaled_hull_out = scaled_hull_in
    wetted_surface_out = wetted_surface_in

else:
    print("Still Running / Not started")
    immersed_volume_out = float("NaN")
    scaled_hull_out = float("NaN")
    wetted_surface_out = float("NaN")
# ---------- end python_10 ----------

division_10 = Division(A=subtraction_7, B=abs)  # disabled
addition_7 = Addition(A=division_10, B=loop_start_2.Data_3)  # disabled
running = Running(
    port=loop_start_2.port,
    Exit=or,
    Data=loop_start_2.Data,
    Data_2=volume_5.Volume,
    Data_3=addition_7,
    TimeOutVal=0,
    pausedState=False,
    state="Constant output")  # -> D0, D1, D2; disabled

division_11 = Division(A=subtraction_6, B=subtraction_9)  # disabled
subtraction_9 = Subtraction(A=loop_start.Data_3, B=division_11)  # disabled
loop_end = LoopEnd(
    port=loop_start.port,
    Exit=False,
    Data=loop_start.Data,
    Data_2=volume_3.Volume,
    Data_3=subtraction_9,
    TimeOutVal=0,
    pausedState=False,
    state="Constant output")  # -> D0, D1, D2; disabled
panel_8 = Panel(loop_end.D2)  # disabled
